# Dynamo graph DYN-DE-PARA-R00.dyn "HDR-Rotina DE-PARA-R00" (Dynamo 3.3.0.6316)

code_block = CodeBlock { Category.ByName(["Pipes", "Pipe Fittings"]); }
all_elements_of_category = ElementsOfCategory(Category=code_block)
getparameter_name = StringInput("")  # graph input
getParameterValueByName = Element.GetParameterValueByName(element=all_elements_of_category, parameterName=getparameter_name)
setparameter_name = StringInput("")  # graph input
setParameterByName = Element.SetParameterByName(element=all_elements_of_category, parameterName=getParameterValueByName, value=setparameter_name)
